# Grasshopper definition TwirlBulbsSolo.gh (Grasshopper 1.0.7)
# plug-ins: NudiBranch

xy_plane = XYPlane(Origin=Point(0, 0, 0))
vector_xyz = VectorXYZ(XComponent=Slider(0.66, range=0..1), YComponent=Slider(0.44, range=0..1), ZComponent=Slider(0, range=-25..25))  # -> Vector, Length
surface = Surface(xy_plane)
scale = Scale(Geometry=surface, Center=vector_xyz.Vector, Factor=Slider(100, range=0.1..100))  # -> Geometry, Transform
countxy = Slider(30, range=0..100)
vector_xyz_2 = VectorXYZ(XComponent=Slider(0, range=0..1), YComponent=Slider(0, range=0..1), ZComponent=Slider(1, range=0..1))  # -> Vector, Length
scale_2 = Scale(Geometry=scale.Geometry, Center=Point(0, 0, 0), Factor=Slider(1, range=0.1..10))  # -> Geometry, Transform
construct_point = ConstructPoint(XCoordinate=Slider(-5, range=-20..20), YCoordinate=Slider(-9, range=-20..20), ZCoordinate=0)
vector_xyz_3 = VectorXYZ(XComponent=Slider(0, range=0..1), YComponent=Slider(0, range=0..1), ZComponent=Slider(1, range=0..1))  # -> Vector, Length
construct_point_2 = ConstructPoint(XCoordinate=Slider(8, range=-20..20), YCoordinate=Slider(20, range=-20..20), ZCoordinate=0)
vector_xyz_4 = VectorXYZ(XComponent=Slider(0, range=0..1), YComponent=Slider(0, range=0..1), ZComponent=Slider(1, range=0..1))  # -> Vector, Length
construct_point_3 = ConstructPoint(XCoordinate=Slider(-20, range=-20..20), YCoordinate=Slider(20, range=-20..20), ZCoordinate=0)
divide_surface = DivideSurface(Surface=scale_2.Geometry, UCount=countxy, VCount=countxy)  # -> Points, Normals, Parameters
range = Slider(16.4, range=0..100)
line_sdl = LineSDL(Start=construct_point, Direction=Vector(0, 0, 1), Length=Slider(25, range=0..100))
range_2 = Slider(15.2, range=0..100)
range_3 = Slider(11.4, range=0..100)
iterations = Slider(5, range=0..10)
line_sdl_2 = LineSDL(Start=construct_point_2, Direction=Vector(0, 0, 1), Length=Slider(25, range=0..100))
line_sdl_3 = LineSDL(Start=construct_point_3, Direction=Vector(0, 0, 1), Length=Slider(30, range=0..100))
force1 = Slider(0.35, range=0..10)
force2 = Slider(2.53, range=0.01..10)
iterations_2 = Slider(1, range=0..20)
iterartions = Slider(15, range=0..20)
force2_2 = Slider(1.4, range=0.01..10)
boolean_toggle = BooleanToggle(True)
twirlattractor = TwirlAttractor(
    Points=divide_surface.Points,
    Attractors=construct_point,
    Range=range_3,
    ClockwiseAnticlockwise=boolean_toggle,
    TwirlingAxis=vector_xyz_2.Vector,
    AscDesc=Toggle(True),
    MinMax=Toggle(True),
    Force=force1,
    Iterations=iterations)  # -> Length, NewPoints, NewVectors
twirlattractor_2 = TwirlAttractor(
    Points=twirlattractor.NewPoints,
    Attractors=construct_point_2,
    Range=range,
    ClockwiseAnticlockwise=boolean_toggle,
    TwirlingAxis=vector_xyz_3.Vector,
    AscDesc=Toggle(True),
    MinMax=Toggle(True),
    Force=force2,
    Iterations=iterations_2)  # -> Length, NewPoints, NewVectors
twirlattractor_3 = TwirlAttractor(
    Points=twirlattractor_2.NewPoints,
    Attractors=construct_point_3,
    Range=range_2,
    ClockwiseAnticlockwise=boolean_toggle,
    TwirlingAxis=vector_xyz_4.Vector,
    AscDesc=Toggle(True),
    MinMax=Toggle(True),
    Force=force2_2,
    Iterations=iterartions)  # -> Length, NewPoints, NewVectors
surface_closest_point = SurfaceClosestPoint(Point=twirlattractor_3.NewPoints, Surface=scale_2.Geometry)  # -> Point, UVPoint, Distance
nurbs_curve = NurbsCurve(Vertices=surface_closest_point.Point, Degree=3, Periodic=False)  # -> Curve, Length, Domain
pull_point = PullPoint(Point=surface_closest_point.Point, Geometry=nurbs_curve.Curve, ClosestOnly=True)  # -> ClosestPoint, Distance
height = Slider(11.63, range=0..100)
remap_numbers = RemapNumbers(Value=pull_point.Distance, Source=Domain(0, 1), Target=Domain(0, 1))  # -> Mapped, Clipped
multiplication = Multiplication(A=remap_numbers.Mapped, B=height)
unit_z = UnitZ(Factor=1)
amplitude = Amplitude(Vector=unit_z, Amplitude=multiplication)
move = Move(Geometry=pull_point.ClosestPoint, Motion=amplitude)  # -> Geometry, Transform
addition = Addition(A=Slider(1, range=0..1), B=countxy)
surface_from_points = SurfaceFromPoints(Points=flatten(move.Geometry), UCount=addition, Interpolate=False)
custom_preview = CustomPreview(Geometry=surface_from_points, Material=ColourSwatch(SwatchColor=RGB(140, 203, 207)))
